# Grasshopper definition drawing-to-polar-coordinate-converter.gh (Grasshopper 1.0.7)

number_slider = Slider(1, range=0..1)
number_slider_2 = Slider(10, range=0..10)
number_slider_3 = Slider(20, range=0..100)
crv = Curve(<curve referenced from the Rhino model>)
crv_2 = Curve(<curve referenced from the Rhino model>)
crv_3 = Curve([<curve referenced from the Rhino model> x14])
topoly = CurveToPolyline(Curve=crv_3, ToleranceDistance=Slider(0.01, range=0..0.01), ToleranceAngle=0)  # -> Polyline, Segments
X = UnitX(Factor=number_slider_3)
Y = UnitY(Factor=number_slider_3)
X_2 = UnitX(Factor=number_slider_3)
Y_2 = UnitY(Factor=number_slider_3)
rev = Reverse(Vector=X)
cp = ControlPoints(Curve=topoly.Polyline)  # -> Points, Weights, Knots
move = Move(Geometry=cp.Points, Motion=X_2)  # -> Geometry, Transform
move_2 = Move(Geometry=cp.Points, Motion=rev)  # -> Geometry, Transform
move_3 = Move(Geometry=move.Geometry, Motion=Y)  # -> Geometry, Transform
tan = TangentLines(Point=move_3.Geometry, Circle=crv_2)  # -> Tangent1, Tangent2
move_4 = Move(Geometry=move_2.Geometry, Motion=Y_2)  # -> Geometry, Transform
tan_2 = TangentLines(Point=move_4.Geometry, Circle=crv)  # -> Tangent1, Tangent2
crv_4 = Curve(tan.Tangent2)
crv_5 = Curve(tan_2.Tangent1)
len = Length(Curve=flatten(crv_5))
len_2 = Length(Curve=flatten(crv_4))
pt = ConstructPoint(XCoordinate=len, YCoordinate=len_2, ZCoordinate=0)
pt_2 = ConstructPoint(XCoordinate=len, YCoordinate=len_2, ZCoordinate=0)
pline = PolyLine(Vertices=pt_2, Closed=False)
